# Grasshopper definition CrossSection_cutting_code.gh (Grasshopper 0.9.76)

crv = Curve(<curve referenced from the Rhino model>)
boundary = BoundarySurfaces(Edges=crv)
c_script = CSharpScript(x=boundary)  # -> out, A; inputs x: Brep
# ---------- c_script: C# ----------
    List<Brep> B = CutBrep(x, Plane.WorldXY, Axis.XAxis);
    A = B;
# ---------- c_script: C# additional code ----------
  public enum Axis
  {
    XAxis,
    YAxis
  }

  public List<Brep> CutBrep(Brep brep, Plane plane, Axis axis)
  {
    Rhino.RhinoDoc doc = Rhino.RhinoDoc.ActiveDoc;

    //Finds the min and max range where the cuts are made
    Tuple<Point3d, Point3d> minAndMax = getMinAndMax(brep, plane);

    //Creates the cutting planes
    List<Plane> cuttingPlanes = getCuttingPlanes(minAndMax.Item1, minAndMax.Item2, plane, axis);

    //Initializes the list where the cutted curves are added
    List<Brep> cutBrepList = new List<Brep>();

    //Transform brep to the local coordinates
    Transform localCoordinates = Transform.PlaneToPlane(plane, Plane.WorldXY);
    brep.Transform(localCoordinates);

    Brep[] brepList = new[] {brep};

    foreach (Plane cuttingPlane in cuttingPlanes)
    {
      Plane cuttingPlane2 = new Plane(cuttingPlane);
      cuttingPlane2.Rotate(Math.PI, cuttingPlane.XAxis, cuttingPlane.Origin);

      List<Brep> tempBrepList = new List<Brep>();
      foreach (Brep brep1 in brepList)
      {
        tempBrepList.AddRange(brep1.Trim(cuttingPlane2, doc.ModelAbsoluteTolerance));
        cutBrepList.AddRange(brep1.Trim(cuttingPlane, doc.ModelAbsoluteTolerance));
      }
      brepList = tempBrepList.ToArray();
    }
    cutBrepList.AddRange(brepList);
    return cutBrepList;
  }

  //This method creates a bounding box to a geometry in a given plane and returns the min and max coordinates of that box in the plane coordinates.
  private Tuple<Point3d, Point3d> getMinAndMax(GeometryBase geometry, Plane plane)
  {

    Transform vali = Transform.PlaneToPlane(Plane.WorldXY, plane);
    BoundingBox box = geometry.GetBoundingBox(plane);
    Point3d minPoint = box.Min;
    Point3d maxPoint = box.Max;

    return Tuple.Create(minPoint, maxPoint);
  }

  //This method will create cutting planes for a geometry in local coordinate axis
  private List<Plane> getCuttingPlanes(Point3d minP, Point3d maxP, Plane plane, Axis axis)
  {

    Tuple<Plane, Vector3d> returnValues = chooseAxis(axis, minP, maxP);
    Plane cuttingPlane = returnValues.Item1;
    Vector3d distance = returnValues.Item2;

    Transform planeTransform = Transform.PlaneToPlane(Plane.WorldXY, plane);
    cuttingPlane.Translate(new Vector3d(minP));

    double count = 20;
    Vector3d step = distance / count;
    int i = 0;
    List<Plane> planeList = new List<Plane>();
    while (i++ < count - 1)
    {
      Plane newPlane = new Plane(cuttingPlane);
      newPlane.Translate(step * i);
      //newPlane.Transform(planeTransform);
      planeList.Add(newPlane);
    }
    return planeList;
  }

  //returns a plane and range of the input geometry according to users choosing
  private Tuple<Plane, Vector3d> chooseAxis(Axis axis, Point3d minP, Point3d maxP)
  {
    switch (axis)
    {
      case Axis.XAxis:
        return Tuple.Create(Plane.WorldZX, new Vector3d(0, maxP.Y - minP.Y, 0));
      case Axis.YAxis:
        return Tuple.Create(Plane.WorldYZ, new Vector3d(maxP.X - minP.X, 0, 0));
      default:
        return Tuple.Create(Plane.WorldZX, new Vector3d(0, maxP.Y - minP.Y, 0));
    }

  }
# ---------- end c_script ----------
srf = Surface(c_script.A)
